# Requirement set Model_Generation_Requirements (R2019b)

## 1 [3] Autonomous Flight
The UAV shall be able to fly a preprogrammed course without pilot intervention.

## 2 [5] Maximum Altitude
Maximum Altitude will be 1000 km

## 3 [4] Payload Mass
The UAV shall support a payload mass of up to 50 kg.

### 3.1 [4.1] Maximum Mass
Maximum Mass is 50 kg

### 3.2 [4.2] Minimum Mass
Minimum Mass is 0 kg

## 4 [2] Payload Power Demand
The UAV shall support a payload power demand of up to 1 kW.