# Requirement set Requirements (R2019b)

## 1 [4] Payload Mass
The UAV shall support a payload mass of up to 50 kg.

### 1.1 [4.1] Maximum Mass
Maximum Mass is 50 kg

### 1.2 [4.2] Minimum Mass
Minimum Mass is 0 kg

## 2 [1] Payload Data Rate
The UAV shall support a payload data rate out of up to 8 Mb/s.

## 3 [2] Payload Power Demand
The UAV shall support a payload power demand of up to 1 kW.

## 4 [3] Autonomous Flight
The UAV shall be able to fly a preprogrammed course without pilot intervention.

## 5 [1] Payload Data Rate
The UAV shall support a payload data rate out of up to 8 Mb/s.

## 6 [2] Payload Power Demand
The UAV shall support a payload power demand of up to 1 kW.

## 7 [3] Autonomous Flight
The UAV shall be able to fly a preprogrammed course without pilot intervention.